# Dynamo graph 20230906SUPPORT_SETUP_T1A.dyn (Dynamo 2.17.0.3472)
# packages: Civil3DToolkit 1.1.13

# group: Selection de l'axe en plan
alignments = AlignmentNamesDropDown("T1 DN600")
current = Autodesk.AutoCAD.DynamoNodes.Document.Current()
string = StringInput("T1A")
byName = Autodesk.Civil.DynamoNodes.LandDevelopment.FeatureLine.ByName(document=current, featurelineName=string)

# group: Importation du fichier csv
file_path = Filename("..\..\..\..\..\..\Downloads\Position_Plot.xlsx")
sheet_name = StringInput("Plots_LNBTP")
openXMLImportExcel = Data.OpenXMLImportExcel(filePath=file_path, sheetName=sheet_name)

# group: Create dictionary from excel data
firstItem = List.FirstItem(list=openXMLImportExcel)
number = DoubleInput(1)
dropItems = List.DropItems(list=openXMLImportExcel, amount=number)
transpose = List.Transpose(lists=dropItems)
byKeysValues = DesignScript.Builtin.Dictionary.ByKeysValues(keys=firstItem, values=transpose)

# group: Excel column headers
string_2 = StringInput("BlockName")
string_3 = StringInput("Station")

# group: Get column values
valueAtKey = DesignScript.Builtin.Dictionary.ValueAtKey(dictionary=byKeysValues, key=string_2)
valueAtKey_2 = DesignScript.Builtin.Dictionary.ValueAtKey(dictionary=byKeysValues, key=string_3)

# group: Get block definition
blockByName = Autodesk.AutoCAD.DynamoNodes.Document.BlockByName(document=current, name=valueAtKey)

# group: Get coordinate systems along feature line
getCoordinateSystemByDistance = Autodesk.Civil.DynamoNodes.LandDevelopment.FeatureLine.GetCoordinateSystemByDistance(featureLine=byName, distance=valueAtKey_2)

# group: Create block reférence
string_4 = StringInput("PLOT")
modelSpace = Autodesk.AutoCAD.DynamoNodes.Document.ModelSpace(document=current)
byCoordinateSystem = Autodesk.AutoCAD.DynamoNodes.BlockReference.ByCoordinateSystem(sourceBlock=blockByName, coordinateSystem=getCoordinateSystemByDistance, layer=string_4, block=modelSpace)
