# Dynamo custom node Basic_00_D4C3D_Helpers.dyf (Dynamo 2.4.1.6326)

# group: PROCESS
# note: Dynamo data & objects creation

# group: DATA IN
# note: Import information / data from others

# group: GET
# note: Get information / data from Civil 3D

# group: NOTES - D4C3D
# note: DESIGN GRAPH STANDARDS
# Author:		Jowenn S. Lua
# Date Created:	10 August 2019
# Date Updated:	24 August 2019
# Version:		002
# DESIGN GRAPH GUIDELINES
# 1. Color code your blocks according to this guide.
# 2. Add grouping with name and description.
# 3. Add notes to explain each critical node process.
# 4. Rename Input / Output / Code Blocks nodes and add suffix to data they carry.
# 5. Align nodes to make it neat.
# 6. Save the graph as Manual instead of Automatic.

# group: SET
# note: Set or Override Parameter in Civil 3D

# group: DATA OUT
# note: Export information / data to others

# group: CREATE
# note: Create object in Civil 3D

# group: TEMP
# note: Not in use / Work in progress / To Debug / To delete

# group: GRAPH INFO
# note: ________________________________________________________
# Dynamo Core Ver: 	2.4.1.6326
# Dynamo Civil 3D Ver: 	2.4.1.1417
# Package Used: 		None
# Custom Nodes Used: 	None
# Graph Function:
# 1. ???
# 2. ???
# 3. ???
# Created By: 		Jowenn S. Lua
# Date Created: 		xx Oct 2019
# Updated By:
# Date Modified:

# group: TEMP
# note: Work in progress / To delete

# group: SET
# note: Set or Override Parameter in Civil 3D

# group: PROCESS
# note: Dynamo data manipulation

# group: GEOM
# note: Dynamo geometry creation

# group: DATA IN
# note: Import information / data from others

# group: DATA OUT
# note: Export information / data to others

# group: NOTES - D4C3D
# note: DESIGN GRAPH STANDARDS
# Author:		Jowenn S. Lua
# Date Created:	10 August 2019
# Date Updated:	27 August 2019
# Version:		003
# DESIGN GRAPH GUIDELINES
# 1. Color code your blocks according to this guide.
# 2. Add grouping with name and description.
# 3. Add notes to explain each critical node process.
# 4. Rename Input / Output / Code Blocks nodes and add suffix to data they carry.
# 5. Align nodes to make it neat.
# 6. Save the graph as Manual instead of Automatic.

# group: GET
# note: Get information / data from Civil 3D

# group: CREATE
# note: Create object in Civil 3D

# group: HOW TO USE THIS? THIS IS LIKE A GUIDE TEMPLATE JUST COPY AND PASTE
# note: HOW TO USE THIS

# group: GET - Current > ModelSpace
current = Autodesk.AutoCAD.DynamoNodes.Document.Current()
modelSpace = Autodesk.AutoCAD.DynamoNodes.Document.ModelSpace(document=current)

code_block = CodeBlock { PassDocMS; }  # unwired: PassDocMS

# group: CREATE - Current > ModelSpace > TextCreate
string = StringInput("Hello AU Las Vegas!!!")
byCoordinates = Point.ByCoordinates()
number = DoubleInput(5)
byCoordinates_2 = Vector.ByCoordinates()
textHorizontalMode = HorizontalMode("Center")
textVerticalMode = VerticalMode("Middle")
string_2 = StringInput("NewLayer1")
create = Autodesk.AutoCAD.DynamoNodes.Text.Create(text=string, insertionPoint=byCoordinates, height=number, rotation=byCoordinates_2, horizontalMode=textHorizontalMode, verticalMode=textVerticalMode, layer=string_2, block=code_block)

# group: GET - Current > ModelSpace > Objects Types
# note: Choose object type e.g. Line, Solid, Surface, etc.
objects_types = AcObjectTypes("Polyline")
current_2 = Autodesk.AutoCAD.DynamoNodes.Document.Current()
modelSpace_2 = Autodesk.AutoCAD.DynamoNodes.Document.ModelSpace(document=current_2)
all_objects_of_type = AcObjectsOfType(type=objects_types, block=modelSpace_2)

# group: GET - Current DWG folder and File - Rename to csv
current_3 = Autodesk.AutoCAD.DynamoNodes.Document.Current()
detail = Autodesk.AutoCAD.DynamoNodes.Document.Detail(document=current_3)
code_block_2 = CodeBlock { "csv"; }
changePathExtension = FileSystem.ChangePathExtension(path=detail.fileName, newExtension=code_block_2)

# group: DATA OUT
# note: This can go inside FIle Path
code_block_3 = CodeBlock(Path=detail.folder, File=changePathExtension) { Path+"\\"+File; }

# group: PROCESS -Object.Geometry (CAD to Geom)
# note: Select object from CAD
select_object = ObjectSelection()  # nothing selected
# note: Convert Obj from CAD to Dyanamo Geometry
geometry = Autodesk.AutoCAD.DynamoNodes.Object.Geometry(object=select_object)

# group: CREATE - Object.ByGeometry (Geom to CAD)
string_layer = StringInput("LayerCreate1")
current_4 = Autodesk.AutoCAD.DynamoNodes.Document.Current()
modelSpace_3 = Autodesk.AutoCAD.DynamoNodes.Document.ModelSpace(document=current_4)
# note: Convert Dynamo Geometry to CAD object
byGeometry = Autodesk.AutoCAD.DynamoNodes.Object.ByGeometry(layer=string_layer, block=modelSpace_3)  # unwired: geometry

# group: GEOM - BoundingBox Points
# note: AutoCAD > Objects > Object
extents = Autodesk.AutoCAD.DynamoNodes.Object.Extents()  # unwired: object
# note: Geometry > Abstract > BoundingBox
minPoint = BoundingBox.MinPoint(boundingBox=extents)

# group: PROCESS - data List X,Y,Z
Z = Point.Z(point=minPoint)
flatten = List.Flatten(list=Z)
Y = Point.Y(point=minPoint)
flatten_2 = List.Flatten(list=Y)
X = Point.X(point=minPoint)
flatten_3 = List.Flatten(list=X)

code_block_pass = CodeBlock { PassListData; }  # unwired: PassListData

# group: DATA OUT - Export to CSV (W/ ATT)
# note: Concatenate Path + prefix + File
code_block_4 = CodeBlock(Path=detail.folder, File=changePathExtension) { Path+"\\"+"WithAtt_"+File; }
# note: Export to CSV
exportCSV = Data.ExportCSV(filePath=code_block_4, data=code_block_pass)

# group: DATA OUT - Export to CSV (No ATT)
# note: Concatenate Path + prefix + File
code_block_5 = CodeBlock(Path=detail.folder, File=changePathExtension) { Path+"\\"+"NoAtt_"+File; }
# note: Export to CSV
exportCSV_2 = Data.ExportCSV(filePath=code_block_5, data=code_block_pass)
