# Dynamo custom node Basic_00_D4C3D_PythonCollection.dyf (Dynamo 2.4.1.6326)

# group: PROCESS - Python Combine Lists
# note: INSTRUCTIONS
# Create a combined list of XYZ and Attributes.
# INPUTS
# [0] List [XYZ]
# [1] List [Attributes]
# OUTPUT
# [0] List [XYZ + Attributes]
# note: Block - with Attribute
python_script_combine_lists = Python()  # unwired: IN[0], IN[1]
# ---------- python_script_combine_lists.python (24 lines) ----------
# Created By: 	Jowenn S. Lua
# Python Name:	Combine Lists
#----------------------------------------------------
# Load the Python Standard and DesignScript Libraries
import sys
import clr

# The inputs to this node will be stored as a list in the IN variables.
dataIn0 = IN[0]
dataIn1 = IN[1]
dataOut = []

# Place your code below
for i, x in enumerate(dataIn0):
	Temp = []
	z = dataIn1[i]
	for j, y in enumerate(x):
		Temp.append(x[j])
	for j, y in enumerate(z):
		Temp.append(z[j])
	dataOut.append(Temp)

# Assign your output to the OUT variable.
OUT = dataOut
# ----------------------------------------

# group: PROCESS - Python Loop Create new list duplicated Nth time
# note: INSTRUCTIONS
# Create a new list from user input list to be duplicated Nth times.
# INPUTS
# [0] List to duplicate (Must be a List)
# [1] List.Count
# [2] Number of times to duplicate (Nth)
# OUTPUT
# [0] New List duplicated Nth times
python_script_loop_list_nth = Python()  # "Python Script - Loop List Nth Times"; unwired: IN[0], IN[1], IN[2]
# ---------- python_script_loop_list_nth.python (22 lines) ----------
# Created By: 	Jowenn S. Lua
# Python Name:	Loop List Nth Times
#----------------------------------------------------
# Load the Python Standard and DesignScript Libraries
import sys
import clr
#clr.AddReference('ProtoGeometry')
#from Autodesk.DesignScript.Geometry import *

# The inputs to this node will be stored as a list in the IN variables.
dataIn0 = IN[0]
dataIn1 = IN[1]
dataIn2 = IN[2]
dataOut = []

# Place your code below this line
for x in range(dataIn2):
	for y in range(dataIn1):
		dataOut.append(dataIn0[y])

# Assign your output to the OUT variable.
OUT = dataOut
# ----------------------------------------

# group: PROCESS - Python Loop List by Value Using Index
# note: INSTRUCTIONS
# Create a new list from list value and using index as result.
# INPUTS
# [0] List of Numbers
# OUTPUT
# [0] New List using Index as result
python_script_loop_list_value_by = Python()  # "Python Script - Loop List Value by Index"; unwired: IN[0]
# ---------- python_script_loop_list_value_by.python (20 lines) ----------
# Created By: 	Jowenn S. Lua
# Python Name:	Loop List Value by Index
#----------------------------------------------------
# Load the Python Standard and DesignScript Libraries
import sys
import clr

# The inputs to this node will be stored as a list in the IN variables.
dataIn = IN[0]
dataOut = []

# Place your code below this line
for a, x in enumerate(dataIn):
	i = 0
	while i < x:
		dataOut.append(a)
		i += 1

# Assign your output to the OUT variable.
OUT = dataOut
# ----------------------------------------

# group: PROCESS - Python Loop List by amount
# note: INSTRUCTIONS
# Create a new list from looping Name with Amount.
# Alternatively, Use List Cycle Nodes
# INPUTS
# [0] Name (Var[])
# [1] Amount (Int)
# OUTPUT
# [0] New List Loop Name with Amount
python_script_list_cycle = Python()  # unwired: IN[0], IN[1]
# ---------- python_script_list_cycle.python (20 lines) ----------
# Created By: 	Jowenn S. Lua
# Python Name:	List Cycle
#----------------------------------------------------
# Load the Python Standard and DesignScript Libraries
import sys
import clr
#clr.AddReference('ProtoGeometry')
#from Autodesk.DesignScript.Geometry import *

# The inputs to this node will be stored as a list in the IN variables.
dataIn0 = IN[0]
dataIn1 = IN[1]
dataOut = []

# Place your code below this line
for x in range(dataIn1):
	dataOut.append(dataIn0)

# Assign your output to the OUT variable.
OUT = dataOut
# ----------------------------------------

# group: PROCESS - Python Station and Offset
# note: INSTRUCTIONS
# Create a dictionary of station and offset from an alignment.
# INPUTS
# [0] List of Alignment name [Str]
# [1] List of Easting [Point.X]
# [2] List of Northing [Point.Y]
# OUTPUT
# [0] Dictionary [Station: Value | Offset: Value]
python_station_offset = Python()  # unwired: IN[0], IN[1], IN[2]
# ---------- python_station_offset.python (111 lines) ----------
"""
Source: https://forum.dynamobim.com/t/selection-method-all-objects-of-type/38954/11

Copyright 2019 Autodesk, Inc. All rights reserved.

This file is part of the Civil 3D Python Module.

"""
__author__ = 'Paolo Emilio Serra - paolo.serra@autodesk.com'
__copyright__ = '2019'
__version__ = '1.0.0'

import clr

# Add Assemblies for AutoCAD and Civil 3D APIs
clr.AddReference('acmgd')
clr.AddReference('acdbmgd')
clr.AddReference('accoremgd')
clr.AddReference('AecBaseMgd')
clr.AddReference('AecPropDataMgd')
clr.AddReference('AeccDbMgd')
clr.AddReference('AeccPressurePipesMgd')
clr.AddReference('acdbmgdbrep')
clr.AddReference('System.Windows.Forms')

# Add standard Python references
import sys
sys.path.append('C:\Program Files (x86)\IronPython 2.7\Lib')
import os
import math

# Add references to manage arrays, collections and interact with the user
from System import *
from System.IO import *
from System.Collections.Specialized import *
from System.Windows.Forms import MessageBox

# Create an alias to the Autodesk.AutoCAD.ApplicationServices.Application class
import Autodesk.AutoCAD.ApplicationServices.Application as acapp

# Import references from AutoCAD
from Autodesk.AutoCAD.Runtime import *
from Autodesk.AutoCAD.ApplicationServices import *
from Autodesk.AutoCAD.EditorInput import *
from Autodesk.AutoCAD.DatabaseServices import *
from Autodesk.AutoCAD.Geometry import *

# Import references for PropertySets
from Autodesk.Aec.PropertyData import *
from Autodesk.Aec.PropertyData.DatabaseServices import *

# Import references for Civil 3D
from Autodesk.Civil.ApplicationServices import *
from Autodesk.Civil.DatabaseServices import *

adoc = acapp.DocumentManager.MdiActiveDocument
cdoc = CivilApplication.ActiveDocument
ed = adoc.Editor

# Example function
def get_soe_by_en(name, easting, northing):
	"""
	Returns a dictioanry with station and offset from the alignment.
	
	:param name: The name of the alignment
	:param easting: The easting value
	:param norhting: The northing value
	:returns: a dictionary with station and offset
	"""
		
	global adoc
	global cdoc
	
	station = clr.Reference[float]()
	offset = clr.Reference[float]()
	
	output = []

	with adoc.LockDocument():
		with adoc.Database as db:
			with db.TransactionManager.StartTransaction() as t:
				bt = t.GetObject(db.BlockTableId, OpenMode.ForWrite)
				btr = t.GetObject(bt[BlockTableRecord.ModelSpace], OpenMode.ForWrite)
				alignment = None
				for oid in cdoc.GetSitelessAlignmentIds():
					al = t.GetObject(oid, OpenMode.ForRead)
					if al.Name == name:
						alignment = al
						break
				# Couldn't find the alignment with the given name
				if alignment is None:
					return
				
				alignment.StationOffset(easting, northing, station, offset)
				
	return {'Station': station.Value, 'Offset': offset.Value}

alignments = IN[0]
easting = IN[1]
northing = IN[2]
	
if not isinstance(alignments, list):
	alignments = [alignments]
	
if not isinstance(easting,list):
	easting = [easting]
	
if not isinstance(northing,list):
	norting = [northing]
	
OUT = [get_soe_by_en(a, e, n) for a, e, n in zip(alignments, easting, northing)]
# ----------------------------------------

# group: PROCESS - Python Convert [x] to [x%]
# note: INSTRUCTIONS
# Convert List of numbers with List of strings plus percent sign. [x] > [x%]
# INPUTS
# [0] List of numbers [x]
# OUTPUT
# [0] List of strings with percent [x%]
python_script_convert_x_to_x = Python()  # unwired: IN[0]
# ---------- python_script_convert_x_to_x.python (18 lines) ----------
# Created By: 	Jowenn S. Lua
# Python Name:	Convert [x] to [x%]
#----------------------------------------------------
# Load the Python Standard and DesignScript Libraries
import sys
import clr


# The inputs to this node will be stored as a list in the IN variables.
dataIn0 = IN[0]
dataOut = []

for x in dataIn0:
	dataOut.append(str(x)+"%")


# Assign your output to the OUT variable.
OUT = dataOut
# ----------------------------------------

# group: PROCESS - Python ListByRepeatedIndex
# note: INSTRUCTIONS
# Create a new list from list of repeated index.
# INPUTS
# [0] List [x]
# [1] List of Repeated Index [i]
# OUTPUT
# [0] New List [var]
python_script = Python()  # "Python Script - ListByRepeatedIndex"; unwired: IN[0], IN[1]
# ---------- python_script.python (19 lines) ----------
# Created By: 	Jowenn S. Lua
# Python Name:	List By Repeated Index
#----------------------------------------------------
# Load the Python Standard and DesignScript Libraries
import sys
import clr


# The inputs to this node will be stored as a list in the IN variables.
dataIn0 = IN[0]
dataIn1 = IN[1]
dataOut = []

# Place your code below this line
for x in dataIn1:
	dataOut.append(dataIn0[x])

# Assign your output to the OUT variable.
OUT = dataOut
# ----------------------------------------

# group: PROCESS - Python NumToStr
# note: INSTRUCTIONS
# Convert Number to String without adding extra zero.
# INPUTS
# [0] List of numbers
# OUTPUT
# [0] List of String (No extra zero added)
python_script_numtostr = Python()  # unwired: IN[0]
# ---------- python_script_numtostr.python (16 lines) ----------
# Created By: 	Jowenn S. Lua
# Python Name:	NumToStr
#----------------------------------------------------
# Load the Python Standard and DesignScript Libraries
import sys
import clr

# The inputs to this node will be stored as a list in the IN variables.
dataIn0 = IN[0]
dataOut = []

for x in dataIn0:
	dataOut.append(str(x)+"")
	
# Assign your output to the OUT variable.
OUT = dataOut
# ----------------------------------------

# group: PROCESS - Python ConcatenateNumStr
# note: INSTRUCTIONS
# Concatenate List of numbers and List of string by converting both to string without adding extra zero.
# INPUTS
# [0] List of numbers
# [1] List of strings
# OUTPUT
# [0] List of Concatenated Number String
python_script_concatenatenumstr = Python()  # unwired: IN[0], IN[1]
# ---------- python_script_concatenatenumstr.python (17 lines) ----------
# Created By: 	Jowenn S. Lua
# Python Name:	ConcatenateNumStr
#----------------------------------------------------
# Load the Python Standard and DesignScript Libraries
import sys
import clr

# The inputs to this node will be stored as a list in the IN variables.
dataIn0 = IN[0]
dataIn1 = IN[1]
dataOut = []

for a, x in enumerate(dataIn0):
	dataOut.append(str(x)+" "+str(dataIn1[a]))
	
# Assign your output to the OUT variable.
OUT = dataOut
# ----------------------------------------
