# Dynamo graph Basic_03_D4C3D_CodeBlock.dyn (Dynamo 2.4.0.5820)

# group: PROCESS
# note: Dynamo data & objects creation

# group: DATA IN
# note: Import information / data from others

# group: GET
# note: Get information / data from Civil 3D

# group: NOTES - D4C3D
# note: DESIGN GRAPH STANDARDS
# Author:		Jowenn S. Lua
# Date Created:	10 August 2019
# Date Updated:	24 August 2019
# Version:		002
# DESIGN GRAPH GUIDELINES
# 1. Color code your blocks according to this guide.
# 2. Add grouping with name and description.
# 3. Add notes to explain each critical node process.
# 4. Rename Input / Output / Code Blocks nodes and add suffix to data they carry.
# 5. Align nodes to make it neat.
# 6. Save the graph as Manual instead of Automatic.

# group: SET
# note: Set or Override Parameter in Civil 3D

# group: DATA OUT
# note: Export information / data to others

# group: CREATE
# note: Create object in Civil 3D

# group: TEMP
# note: Not in use / Work in progress / To Debug / To delete

# group: DATA IN - Uses of Code Blocks (Sample)
# note: As Number
code_block = CodeBlock { 10; }
# note: As String
code_block_2 = CodeBlock { "text"; }
# note: As Formula
code_block_3 = CodeBlock { 2*5; }
# note: As Variable
code_block_4 = CodeBlock { A=10; B=A+A; }
# note: As Range Start..End
code_block_5 = CodeBlock { 1..4; }
# note: As Math Function
code_block_6 = CodeBlock { Math.PI; }
# note: As Conditional Statement
code_block_7 = CodeBlock { (x?y:z); }  # unwired: x, y, z
# note: As List
code_block_8 = CodeBlock { [5,"Text",4]; }
# note: As Design Script
# Creating line1 from point1 and point2
# Creating mirror of line1 via plane1
code_block_9 = CodeBlock()
# ---------- code_block_9.designscript (5 lines) ----------
point1 = Point.ByCoordinates(0, 0, 0);
point2 = Point.ByCoordinates(5, 2, 4);
line1 = DesignScript.Line.ByStartPointEndPoint(point1, point2);
plane1 = Plane.XY();
geometry1 = Geometry.Mirror(line1, plane1);
# ----------------------------------------
# note: As Dictionary
code_block_10 = CodeBlock { a = {"Name":"John", "Surname":"Smith","Age":5}; }

code_block_11 = CodeBlock {  }
