# Dynamo graph Basic_04_D4C3D_Get_Current_Model_Space.dyn (Dynamo 2.4.0.5820)

# group: PROCESS
# note: Dynamo data & objects creation

# group: DATA IN
# note: Import information / data from others

# group: GET
# note: Get information / data from Civil 3D

# group: NOTES - D4C3D
# note: DESIGN GRAPH STANDARDS
# Author:		Jowenn S. Lua
# Date Created:	10 August 2019
# Date Updated:	24 August 2019
# Version:		002
# DESIGN GRAPH GUIDELINES
# 1. Color code your blocks according to this guide.
# 2. Add grouping with name and description.
# 3. Add notes to explain each critical node process.
# 4. Rename Input / Output / Code Blocks nodes and add suffix to data they carry.
# 5. Align nodes to make it neat.
# 6. Save the graph as Manual instead of Automatic.

# group: SET
# note: Set or Override Parameter in Civil 3D

# group: DATA OUT
# note: Export information / data to others

# group: CREATE
# note: Create object in Civil 3D

# group: TEMP
# note: Not in use / Work in progress / To Debug / To delete

# group: GET - Current > ModelSpace
current = Autodesk.AutoCAD.DynamoNodes.Document.Current()
modelSpace = Autodesk.AutoCAD.DynamoNodes.Document.ModelSpace(document=current)

# group: GET - Current > PaperSpace
current_2 = Autodesk.AutoCAD.DynamoNodes.Document.Current()
paperSpace = Autodesk.AutoCAD.DynamoNodes.Document.PaperSpace(document=current_2)
