# Dynamo graph Basic_06_D4C3D_Get_Path+File+Ext.dyn (Dynamo 2.4.1.6326)

# group: GET - Current DWG folder and File - Rename to csv
current = Autodesk.AutoCAD.DynamoNodes.Document.Current()
detail = Autodesk.AutoCAD.DynamoNodes.Document.Detail(document=current)
code_block = CodeBlock { "csv"; }
changePathExtension = FileSystem.ChangePathExtension(path=detail.fileName, newExtension=code_block)

# group: DATA OUT
# note: This can go inside FIle Path
code_block_2 = CodeBlock(Path=detail.folder, File=changePathExtension) { Path+"\\"+File; }
