# Dynamo graph Basic_07_D4C3D_CAD_TextCreate.dyn (Dynamo 2.4.1.6326)

# group: PROCESS
# note: Dynamo data & objects creation

# group: DATA IN
# note: Import information / data from others

# group: GET
# note: Get information / data from Civil 3D

# group: NOTES - D4C3D
# note: DESIGN GRAPH STANDARDS
# Author:		Jowenn S. Lua
# Date Created:	10 August 2019
# Date Updated:	24 August 2019
# Version:		002
# DESIGN GRAPH GUIDELINES
# 1. Color code your blocks according to this guide.
# 2. Add grouping with name and description.
# 3. Add notes to explain each critical node process.
# 4. Rename Input / Output / Code Blocks nodes and add suffix to data they carry.
# 5. Align nodes to make it neat.
# 6. Save the graph as Manual instead of Automatic.

# group: SET
# note: Set or Override Parameter in Civil 3D

# group: DATA OUT
# note: Export information / data to others

# group: CREATE
# note: Create object in Civil 3D

# group: TEMP
# note: Not in use / Work in progress / To Debug / To delete

# group: GET - Current > ModelSpace
current = Autodesk.AutoCAD.DynamoNodes.Document.Current()
modelSpace = Autodesk.AutoCAD.DynamoNodes.Document.ModelSpace(document=current)

# group: CREATE - Current > ModelSpace > TextCreate
string = StringInput("Hello AU Las Vegas!!!")
byCoordinates = Point.ByCoordinates()
number = DoubleInput(5)
byCoordinates_2 = Vector.ByCoordinates()
textHorizontalMode = HorizontalMode("Center")
textVerticalMode = VerticalMode("Middle")
string_2 = StringInput("NewLayer1")
create = Autodesk.AutoCAD.DynamoNodes.Text.Create(text=string, insertionPoint=byCoordinates, height=number, rotation=byCoordinates_2, horizontalMode=textHorizontalMode, verticalMode=textVerticalMode, layer=string_2, block=modelSpace)
