# Dynamo graph Python_D4C3D_LoopListByValueUsingIndex.dyn (Dynamo 2.4.0.5820)

# group: PROCESS
# note: Dynamo data & objects creation

# group: DATA IN
# note: Import information / data from others

# group: GET
# note: Get information / data from Civil 3D

# group: NOTES - D4C3D
# note: DESIGN GRAPH STANDARDS
# Author:		Jowenn S. Lua
# Date Created:	10 August 2019
# Date Updated:	24 August 2019
# Version:		002
# DESIGN GRAPH GUIDELINES
# 1. Color code your blocks according to this guide.
# 2. Add grouping with name and description.
# 3. Add notes to explain each critical node process.
# 4. Rename Input / Output / Code Blocks nodes and add suffix to data they carry.
# 5. Align nodes to make it neat.
# 6. Save the graph as Manual instead of Automatic.

# group: SET
# note: Set or Override Parameter in Civil 3D

# group: DATA OUT
# note: Export information / data to others

# group: CREATE
# note: Create object in Civil 3D

# group: TEMP
# note: Not in use / Work in progress / To Debug / To delete

# group: DATA IN - User Input as List
# note: List Data using integer = will work as normal
# List Data using double = will work + 1
# List Data using string = WILL NOT WORK
code_block = CodeBlock { [3, 2, 4, 6]; }

# group: PROCESS - Python Loop List by Value Using Index
# note: INSTRUCTIONS
# Create a new list from list value and using index as result.
# INPUTS
# [0] List of Numbers
# OUTPUT
# [0] New List using Index as result
python_script_loop_list_value_by = Python(IN[0]=code_block)  # "Python Script - Loop List Value by Index"
# ---------- python_script_loop_list_value_by.python (18 lines) ----------
# Created by: Jowenn S. Lua
# Load the Python Standard and DesignScript Libraries
import sys
import clr

# The inputs to this node will be stored as a list in the IN variables.
dataIn = IN[0]
dataOut = []

# Place your code below this line
for a, x in enumerate(dataIn):
	i = 0
	while i < x:
		dataOut.append(a)
		i += 1

# Assign your output to the OUT variable.
OUT = dataOut
# ----------------------------------------

watch = Watch(python_script_loop_list_value_by)
