# Dynamo graph Python_D4C3D_LoopListNthTimes.dyn (Dynamo 2.4.1.6326)

# group: PROCESS
# note: Dynamo data & objects creation

# group: DATA IN
# note: Import information / data from others

# group: GET
# note: Get information / data from Civil 3D

# group: NOTES - D4C3D
# note: DESIGN GRAPH STANDARDS
# Author:		Jowenn S. Lua
# Date Created:	10 August 2019
# Date Updated:	24 August 2019
# Version:		002
# DESIGN GRAPH GUIDELINES
# 1. Color code your blocks according to this guide.
# 2. Add grouping with name and description.
# 3. Add notes to explain each critical node process.
# 4. Rename Input / Output / Code Blocks nodes and add suffix to data they carry.
# 5. Align nodes to make it neat.
# 6. Save the graph as Manual instead of Automatic.

# group: SET
# note: Set or Override Parameter in Civil 3D

# group: DATA OUT
# note: Export information / data to others

# group: CREATE
# note: Create object in Civil 3D

# group: TEMP
# note: Not in use / Work in progress / To Debug / To delete

# group: DATA IN - User Input
code_block = CodeBlock { ["TestPoint", "Testlink", "YYY", "UUU"]; }
count = List.Count(list=code_block)
integer_slider = IntegerSlider(3, range=1..5 step 1)

# group: PROCESS - Python Loop Create new list duplicated Nth time
# note: INSTRUCTIONS
# Create a new list from user input list to be duplicated Nth times.
# INPUTS
# [0] List to duplicate (Must be a List)
# [1] List.Count
# [2] Number of times to duplicate (Nth)
# OUTPUT
# [0] New List duplicated Nth times
python_script_loop_list_nth = Python(IN[0]=code_block, IN[1]=count, IN[2]=integer_slider)  # "Python Script - Loop List Nth Times"
# ---------- python_script_loop_list_nth.python (22 lines) ----------
# Created By: 	Jowenn S. Lua
# Python Name:	Loop List Nth Times
#----------------------------------------------------
# Load the Python Standard and DesignScript Libraries
import sys
import clr
#clr.AddReference('ProtoGeometry')
#from Autodesk.DesignScript.Geometry import *

# The inputs to this node will be stored as a list in the IN variables.
dataIn0 = IN[0]
dataIn1 = IN[1]
dataIn2 = IN[2]
dataOut = []

# Place your code below this line
for x in range(dataIn2):
	for y in range(dataIn1):
		dataOut.append(dataIn0[y])

# Assign your output to the OUT variable.
OUT = dataOut
# ----------------------------------------

watch = Watch(python_script_loop_list_nth)

# group: DATA IN - String to List
string = StringInput("ConvertStringToList")
list_create = List.Create(item0=string)

cycle = List.Cycle(list=code_block, amount=integer_slider)
watch_2 = Watch(cycle)
