# Dynamo graph Python_D4C3D_NumToStn_ConcatenateNumStr.dyn (Dynamo 2.4.1.6326)

# group: TEMP
# note: Not in use / Work in progress / To Debug / To delete

# group: NOTES - D4C3D
# note: DESIGN GRAPH STANDARDS
# Author:		Jowenn S. Lua
# Date Created:	10 August 2019
# Date Updated:	24 August 2019
# Version:		002
# DESIGN GRAPH GUIDELINES
# 1. Color code your blocks according to this guide.
# 2. Add grouping with name and description.
# 3. Add notes to explain each critical node process.
# 4. Rename Input / Output / Code Blocks nodes and add suffix to data they carry.
# 5. Align nodes to make it neat.
# 6. Save the graph as Manual instead of Automatic.

# group: PROCESS
# note: Dynamo data & objects creation

# group: SET
# note: Set or Override Parameter in Civil 3D

# group: DATA IN
# note: Import information / data from others

# group: DATA OUT
# note: Export information / data to others

# group: GET
# note: Get information / data from Civil 3D

# group: CREATE
# note: Create object in Civil 3D

# group: DATA IN
code_block = CodeBlock { [1937.3,0,12,12,12,3597.9,2395.7]; }
code_block_2 = CodeBlock { ["RT","","RT","LT","LT","RT","RT"]; }

watch = Watch(code_block)
watch_2 = Watch(code_block_2)

# group: PROCESS - Python ConcatenateNumStr
# note: INSTRUCTIONS
# Concatenate List of numbers and List of string by converting both to string without adding extra zero.
# INPUTS
# [0] List of numbers
# [1] List of strings
# OUTPUT
# [0] List of Concatenated Number String
python_script_concatenatenumstr = Python(IN[0]=watch, IN[1]=watch_2)
# ---------- python_script_concatenatenumstr.python (17 lines) ----------
# Created By: 	Jowenn S. Lua
# Python Name:	ConcatenateNumStr
#----------------------------------------------------
# Load the Python Standard and DesignScript Libraries
import sys
import clr

# The inputs to this node will be stored as a list in the IN variables.
dataIn0 = IN[0]
dataIn1 = IN[1]
dataOut = []

for a, x in enumerate(dataIn0):
	dataOut.append(str(x)+" "+str(dataIn1[a]))
	
# Assign your output to the OUT variable.
OUT = dataOut
# ----------------------------------------

watch_3 = Watch(python_script_concatenatenumstr)
watch_4 = Watch(code_block)

# group: PROCESS - Python NumToStr
# note: INSTRUCTIONS
# Convert Number to String without adding extra zero.
# INPUTS
# [0] List of numbers
# OUTPUT
# [0] List of String (No extra zero added)
python_script_numtostr = Python(IN[0]=watch_4)
# ---------- python_script_numtostr.python (16 lines) ----------
# Created By: 	Jowenn S. Lua
# Python Name:	NumToStr
#----------------------------------------------------
# Load the Python Standard and DesignScript Libraries
import sys
import clr

# The inputs to this node will be stored as a list in the IN variables.
dataIn0 = IN[0]
dataOut = []

for x in dataIn0:
	dataOut.append(str(x)+"")
	
# Assign your output to the OUT variable.
OUT = dataOut
# ----------------------------------------

watch_5 = Watch(code_block_2)
code_block_3 = CodeBlock(a=python_script_numtostr, b=watch_5) { a+" "+b; }
watch_6 = Watch(code_block_3)
