# Dynamo graph Sample_D4C3D_DataExportCSV(Dyn-CSV).dyn (Dynamo 2.4.1.6326)

# group: Refer to Autodesk out of the box Sample Data
# note: C:\ProgramData\Autodesk\C3D 2020\Dynamo\Samples\Data

# note: Use File Path node to browse excel CSV file to use
file_path = Filename("..\..\Data\icosohedron_points.csv")
number_slider = DoubleSlider(1.793, range=0..5 step 0.1)
code_block = CodeBlock(numCircles=number_slider) { 0..(360*numCircles)..10; }
cos = Math.Cos(angle=code_block, lacing=Longest)
sin = Math.Sin(angle=code_block, lacing=Longest)
code_block_2 = CodeBlock(x=code_block) { x/100; }
byCoordinates = Point.ByCoordinates(x=cos, y=sin, z=code_block_2, lacing=Longest)
code_block_3 = CodeBlock(pt=byCoordinates) { [pt.X,pt.Y,pt.Z]; }
# note: List of Data to Export
transpose = List.Transpose(lists=code_block_3)
# note: Dynamo to CSV Data
exportCSV = Data.ExportCSV(filePath=file_path, data=transpose)
