# Dynamo graph Sample_D4C3D_DataExportExcel(Dyn-Excel).dyn (Dynamo 2.4.1.6326)

# group: Refer to Autodesk out of the box Sample Data
# note: C:\ProgramData\Autodesk\C3D 2020\Dynamo\Samples\Data

# note: Use File Path node to browse excel file to use
file_path = Filename("..\..\ProgramData\Autodesk\C3D 2020\Dynamo\Samples\Data\icosohedron_points.xlsx")
string = StringInput("helix")
number = DoubleInput(0)
number_slider = DoubleSlider(1.793, range=0..5 step 0.1)
code_block = CodeBlock(numCircles=number_slider) { 0..(360*numCircles)..10; }
cos = Math.Cos(angle=code_block, lacing=Longest)
sin = Math.Sin(angle=code_block, lacing=Longest)
code_block_2 = CodeBlock(x=code_block) { x/100; }
byCoordinates = Point.ByCoordinates(x=cos, y=sin, z=code_block_2, lacing=Longest)
code_block_3 = CodeBlock(pt=byCoordinates) { [pt.X,pt.Y,pt.Z]; }
# note: List of Data to Export
transpose = List.Transpose(lists=code_block_3)
# note: Overwrite excel file? T/F
# note: Sheet name to write data to
# note: Rows and Columns start at
# 0,1,2 and so on...
boolean = BoolSelector(false)
# note: Dynamo to Excel Data
exportExcel = Data.ExportExcel(filePath=file_path, sheetName=string, startRow=number, startCol=number, data=transpose, overWrite=boolean)
