# Dynamo graph Sample_D4C3D_DataImportCSV(CSV-Dyn).dyn (Dynamo 2.4.1.6326)

# group: Refer to Autodesk out of the box Sample Data
# note: C:\ProgramData\Autodesk\C3D 2020\Dynamo\Samples\Data

# note: Browse a CSV file that has numbers
# in x, y, and z coordinate space
file_path = Filename("..\..\Data\helix.csv")
boolean = BoolSelector(false)
importCSV = Data.ImportCSV(filePath=file_path, transpose=boolean)
code_block = CodeBlock(a=importCSV) { a[0]; a[1]; a[2]; }
byCoordinates = Point.ByCoordinates(x=code_block.out0, y=code_block.out1, z=code_block.out2)
number_slider = DoubleSlider(2.337, range=0..20 step 0.1)
# note: Adjust the overall distribution
# of the coordinate points
scale = Geometry.Scale(geometry=byCoordinates, amount=number_slider, lacing=Longest)
