# Dynamo graph Sample_D4C3D_DataImportExcel(Excel-Dyn).dyn (Dynamo 2.4.1.6326)

# group: Refer to Autodesk out of the box Sample Data
# note: C:\ProgramData\Autodesk\C3D 2020\Dynamo\Samples\Data

# note: Browse Excel file to get File Path
file_path = Filename("..\..\Data\helix.xlsx")
# note: Get the File from File Path
fromPath = FileObject(path=file_path)  # "File.FromPath"
# note: Excel sheet name tab to get the data
string = StringInput("helix")
# note: Read data as string? T/F
boolean = BoolSelector(false)
# note: Open & display Excel? T/F
boolean_2 = BoolSelector(true)
# note: Excel Data to Dynamo
importExcel = Data.ImportExcel(file=fromPath, sheetName=string, readAsStrings=boolean, showExcel=boolean_2)
transpose = List.Transpose(lists=importExcel)
number = DoubleInput(0)
getItemAtIndex = List.GetItemAtIndex(list=transpose, index=number)
number_2 = DoubleInput(1)
getItemAtIndex_2 = List.GetItemAtIndex(list=transpose, index=number_2)
number_3 = DoubleInput(2)
getItemAtIndex_3 = List.GetItemAtIndex(list=transpose, index=number_3)
byCoordinates = Point.ByCoordinates(x=getItemAtIndex, y=getItemAtIndex_2, z=getItemAtIndex_3, lacing=Longest)
