# Dynamo graph Sample_D4C3D_DecimalToStnFormat.dyn (Dynamo 2.4.1.6326)

# group: PROCESS
# note: Dynamo data & objects creation

# group: DATA IN
# note: Import information / data from others

# group: GET
# note: Get information / data from Civil 3D

# group: NOTES - D4C3D
# note: DESIGN GRAPH STANDARDS
# Author:		Jowenn S. Lua
# Date Created:	10 August 2019
# Date Updated:	24 August 2019
# Version:		002
# DESIGN GRAPH GUIDELINES
# 1. Color code your blocks according to this guide.
# 2. Add grouping with name and description.
# 3. Add notes to explain each critical node process.
# 4. Rename Input / Output / Code Blocks nodes and add suffix to data they carry.
# 5. Align nodes to make it neat.
# 6. Save the graph as Manual instead of Automatic.

# group: TEMP
# note: Not in use / Work in progress / To Debug / To delete

# group: SET
# note: Set or Override Parameter in Civil 3D

# group: DATA OUT
# note: Export information / data to others

# group: CREATE
# note: Create object in Civil 3D

# group: OPTION 1 - Using basic nodes
# note: OPTION 1

# group: OPTION 2 - Converted to codes
# note: OPTION 2

# group: DATA IN
# note: List of Station in Decimal
# to be converted to X+XX.XX
code_block = CodeBlock { [10.12345,100.12345,1000.12345]; }
code_block_2 = CodeBlock { 2; }

# group: PROCESS - List to round to 2 decimal > Manipulate list to use Station Format X+XX.XX
round = Math.Round(number=code_block, digits=code_block_2)
code_block_3 = CodeBlock(a=round) { a/100; }
string_from_object = FromObject(obj=code_block_3)
code_block_4 = CodeBlock { "."; }
split = String.Split(str=string_from_object, separator0=code_block_4)
firstItem = List.FirstItem(list=split@L2)
code_block_5 = CodeBlock { "+"; }
lastItem = List.LastItem(list=split@L2)
code_block_6 = CodeBlock { 2; "."; }
insert = String.Insert(str=lastItem, index=code_block_6.out0, toInsert=code_block_6.out1)
code_block_7 = CodeBlock { 5; 2; }
remove = String.Remove(str=insert, startIndex=code_block_7.out0, count=code_block_7.out1)

# group: DATA OUT
code_block_8 = CodeBlock(a=firstItem, b=code_block_5, c=remove) { List.Flatten([a+b+c],-1); }
watch = Watch(code_block_8)

# group: DATA IN
code_block_9 = CodeBlock { [10.12345,100.12345,1000.12345]; }

# group: PROCESS - Math > String
# note: Math Calc Round 2 Decimal
code_block_10 = CodeBlock(a=code_block_9) { Math.Round(a, 2) / 100; }
# note: Convert to String
string_from_object_2 = FromObject(obj=code_block_10)

# group: DATA OUT
# note: Convert to X+XX.XX
code_block_11 = CodeBlock(str=string_from_object_2)
# ---------- code_block_11.designscript (6 lines) ----------
split = String.Split(str, ["."]);
a= List.FirstItem(split@L2<1>);
t1 = List.LastItem(split@L2<1>);
str2 = String.Insert(t1, 2, ".");
c=String.Remove(str2, 5, 2);
List.Flatten([a+"+"+c],-1);
# ----------------------------------------
watch_2 = Watch(code_block_11.out5)
