# Dynamo graph Sample_D4C3D_GeometryCosestPointTo.dyn (Dynamo 2.4.0.5820)

# group: DATA IN
# note: Import information / data from others

# group: GET
# note: Get information / data from Civil 3D

# group: PROCESS
# note: Dynamo data & objects creation

# group: SET
# note: Set or Override Parameter in Civil 3D

# group: DATA OUT
# note: Export information / data to others

# group: CREATE
# note: Create object in Civil 3D

# group: NOTES - D4C3D
# note: DESIGN GRAPH STANDARDS
# Author:		Jowenn S. Lua
# Date Created:	10 August 2019
# Date Updated:	24 August 2019
# Version:		002
# DESIGN GRAPH GUIDELINES
# 1. Color code your blocks according to this guide.
# 2. Add grouping with name and description.
# 3. Add notes to explain each critical node process.
# 4. Rename Input / Output / Code Blocks nodes and add suffix to data they carry.
# 5. Align nodes to make it neat.
# 6. Save the graph as Manual instead of Automatic.

# group: TEMP
# note: Not in use / Work in progress / To Debug / To delete

# group: DATA IN - User Inp
number_slider = DoubleSlider(-3, range=-5..5 step 1)
number_slider_2 = DoubleSlider(4, range=1..5 step 1)

byCoordinates = Point.ByCoordinates(x=number_slider, y=number_slider, z=number_slider_2)
byCenterPointRadius = Sphere.ByCenterPointRadius(centerPoint=byCoordinates)
byCoordinates_2 = Point.ByCoordinates()

# group: PROCESS - Geometry.ClosestPointTo
# note: Return a point from geometry closest to other
closestPointTo = Geometry.ClosestPointTo(geometry=byCenterPointRadius, other=byCoordinates_2)
watch = Watch(closestPointTo)

byStartPointEndPoint = Line.ByStartPointEndPoint(startPoint=watch, endPoint=byCoordinates_2)
