# Dynamo graph Sample_D4C3D_ObjectByGeometry(Geom-CAD).dyn (Dynamo 2.4.1.6326)

# group: TEMP
# note: Not in use / Work in progress / To Debug / To delete

# group: NOTES - D4C3D
# note: DESIGN GRAPH STANDARDS
# Author:		Jowenn S. Lua
# Date Created:	10 August 2019
# Date Updated:	24 August 2019
# Version:		002
# DESIGN GRAPH GUIDELINES
# 1. Color code your blocks according to this guide.
# 2. Add grouping with name and description.
# 3. Add notes to explain each critical node process.
# 4. Rename Input / Output / Code Blocks nodes and add suffix to data they carry.
# 5. Align nodes to make it neat.
# 6. Save the graph as Manual instead of Automatic.

# group: PROCESS
# note: Dynamo data & objects creation

# group: SET
# note: Set or Override Parameter in Civil 3D

# group: DATA IN
# note: Import information / data from others

# group: DATA OUT
# note: Export information / data to others

# group: GET
# note: Get information / data from Civil 3D

# group: CREATE
# note: Create object in Civil 3D

# group: DATA IN
number = DoubleInput(0)
number_2 = DoubleInput(1)
number_slider = DoubleSlider(3, range=0..10 step 1)

# group: PROCESS - Line.ByStartPointEndPoint
byCoordinates = Point.ByCoordinates(x=number, y=number, z=number_2)
byCoordinates_2 = Point.ByCoordinates(x=number_slider, y=number_slider, z=number_slider)
byStartPointEndPoint = Line.ByStartPointEndPoint(startPoint=byCoordinates, endPoint=byCoordinates_2)

# group: CREATE - Object.ByGeometry (Geom to CAD)
string_layer = StringInput("LayerCreate1")
current = Autodesk.AutoCAD.DynamoNodes.Document.Current()
modelSpace = Autodesk.AutoCAD.DynamoNodes.Document.ModelSpace(document=current)
# note: Convert Dynamo Geometry to CAD object
byGeometry = Autodesk.AutoCAD.DynamoNodes.Object.ByGeometry(geometry=byStartPointEndPoint, layer=string_layer, block=modelSpace)
