# Dynamo graph Sample_D4C3D_PointsPruneDuplicate.dyn (Dynamo 2.4.0.5820)

# group: TEMP
# note: Not in use / Work in progress / To Debug / To delete

# group: PROCESS
# note: Dynamo data & objects creation

# group: SET
# note: Set or Override Parameter in Civil 3D

# group: NOTES - D4C3D
# note: DESIGN GRAPH STANDARDS
# Author:		Jowenn S. Lua
# Date Created:	10 August 2019
# Date Updated:	24 August 2019
# Version:		002
# DESIGN GRAPH GUIDELINES
# 1. Color code your blocks according to this guide.
# 2. Add grouping with name and description.
# 3. Add notes to explain each critical node process.
# 4. Rename Input / Output / Code Blocks nodes and add suffix to data they carry.
# 5. Align nodes to make it neat.
# 6. Save the graph as Manual instead of Automatic.

# group: DATA IN
# note: Import information / data from others

# group: DATA OUT
# note: Export information / data to others

# group: GET
# note: Get information / data from Civil 3D

# group: CREATE
# note: Create object in Civil 3D

byCoordinates = Point.ByCoordinates()
number = DoubleInput(10)
byCoordinates_2 = Point.ByCoordinates(z=number)
list_create = List.Create(item0=byCoordinates, item1=byCoordinates, item2=byCoordinates, item3=byCoordinates_2, item4=byCoordinates_2)

# group: PROCESS - Point.PruneDuplicates
# note: Deletes all duplicated points
pruneDuplicates = Point.PruneDuplicates(points=list_create)
