# Dynamo graph Sample_D4C3D_RangesAndList.dyn "Sample_D4C3D_ListAndRanges" (Dynamo 2.4.1.6326)

# group: DATA IN
# note: Import information / data from others

# group: GET
# note: Get information / data from Civil 3D

# group: PROCESS
# note: Dynamo data & objects creation

# group: SET
# note: Set or Override Parameter in Civil 3D

# group: DATA OUT
# note: Export information / data to others

# group: CREATE
# note: Create object in Civil 3D

# group: NOTES - D4C3D
# note: DESIGN GRAPH STANDARDS
# Author:		Jowenn S. Lua
# Date Created:	10 August 2019
# Date Updated:	24 August 2019
# Version:		002
# DESIGN GRAPH GUIDELINES
# 1. Color code your blocks according to this guide.
# 2. Add grouping with name and description.
# 3. Add notes to explain each critical node process.
# 4. Rename Input / Output / Code Blocks nodes and add suffix to data they carry.
# 5. Align nodes to make it neat.
# 6. Save the graph as Manual instead of Automatic.

# group: TEMP
# note: Not in use / Work in progress / To Debug / To delete

# group: Ranges
end = CodeBlock { 0..4; }  # "Start..End"
step = CodeBlock { 0..10..3; }  # "Start..End..Step"
start_end_step = CodeBlock { 0..10..~3; }
start_end_items = CodeBlock { 0..11..#3; }
start_items_step = CodeBlock { 0..#4..5; }

list_create = List.Create(item0=end, item1=step, item2=start_end_step, item3=start_end_items, item4=start_items_step)

# group: List
list_a = CodeBlock(L=list_create) { L[3]; }
list_a_2 = CodeBlock(L=list_create) { L[-1]; }
list_a_b = CodeBlock(L=list_create) { L[2][3]; }
list_a_b_2 = CodeBlock(L=list_create) { L[2..3]; }
list_a_b_c = CodeBlock(L=list_create) { L[[2,3,4]]; }
a_b_c_1_2_3 = CodeBlock { [1,"Hello",2,"AU",2019]; }
