# Dynamo graph Import_FeatureLine_From_Exel.dyn "Import_Fealtine_From_Exel" (Dynamo 2.15.1.6076)
# packages: Camber 4.2.6, Civil3DToolkit 1.1.32

# group: next phase when i got the necessary knowlegde to develop 0 tocuh node
code_block = CodeBlock { "T3A"; }  # frozen
byName = Camber.Civil.PressureNetworks.PressureNetwork.ByName(name=code_block)  # frozen
code_block_2 = CodeBlock { "T3A"; }  # frozen
getPressurePartsLists = Camber.Civil.PressureNetworks.PressurePartsList.GetPressurePartsLists()  # frozen; unwired: document
code_block_3 = CodeBlock { 1; }
getItemAtIndex = List.GetItemAtIndex(list=getPressurePartsLists, index=code_block_3)
pressure_part_domains = PressurePartDomainDropDown("Pipe", EnumerationType="Autodesk.Civil.DatabaseServices.PressurePartDomainType, AeccPressurePipesMgd, Version=13.5.1125.0, Culture=neutral, PublicKeyToken=null", AddSpaces=false, DropLastCharacter=false)  # frozen
getPartsByDomain = Camber.Civil.PressureNetworks.PressurePartsList.GetPartsByDomain(pressurePartsList=getItemAtIndex, pressurePartDomain=pressure_part_domains)
boolean = BoolSelector(true)  # frozen
byObject = Camber.Civil.PressureNetworks.PressurePipeRun.ByObject(pressureNetwork=byName, name=code_block_2, pressurePartSize=getPartsByDomain, autoAddFittings=boolean)  # frozen; unwired: object, surfaceOffset
objectByGeometry = Autodesk.AutoCAD.DynamoNodes.PolylineExtensions.ObjectByGeometry()  # frozen; unwired: curve

# group: Feature line name
code_block_4 = CodeBlock { "T2A"; }

# group: Input
file_path = Filename("..\OneDrive - DENYS nv (1)\ETUDES ET EXECUTION CHANTIER\23. Dossiers d'exécution\06. T2A DN350 & T3A DE250\Axe_TOP_T2A.xlsx")

# group: Extraction data from exel for x,y,z
file_from_path = FileObject(path=file_path)
code_block_5 = CodeBlock { "Feuil1"; }
importExcel = Data.ImportExcel(file=file_from_path, sheetName=code_block_5)
transpose = List.Transpose(lists=importExcel)
code_block_6 = CodeBlock { 0; 1; 2; }
abscisses = List.GetItemAtIndex(list=transpose, index=code_block_6.out0)
ordonnées = List.GetItemAtIndex(list=transpose, index=code_block_6.out1)
elevations = List.GetItemAtIndex(list=transpose, index=code_block_6.out2)

# group: Feature line creation
byCoordinates = Point.ByCoordinates(x=abscisses, y=ordonnées, z=elevations)
byPoints = PolyCurve.ByPoints(points=byCoordinates)
code_block_7 = CodeBlock { "C-TOPO-FEAT"; }
current = Autodesk.AutoCAD.DynamoNodes.Document.Current()
modelSpace = Autodesk.AutoCAD.DynamoNodes.Document.ModelSpace(document=current)
byPolyCurve = Autodesk.Civil.DynamoNodes.LandDevelopment.FeatureLine.ByPolyCurve(name=code_block_4, curve=byPoints, layer=code_block_7, block=modelSpace)
