# Dynamo graph ReplaceMutlitplePatters_text.dyn (Dynamo 2.15.1.6076)

code_block = CodeBlock()
# ---------- code_block.designscript (27 lines) ----------
//Function to replace multiple texts
def ReplaceMultiplePatterns(texts: string[]..[],searchpatterns: string[],replacements: string[])

{
 return [Imperative]
{
  result = [];
 //Result is a list;

  //Loop through all lists of texts
   for (i in 0..List.Count(texts)-1)
	{
		currenttext = texts[i];

		//Loop through the search patterns that must be replaced
		for (j in 0..List.Count(searchpatterns)-1)
		  {
			currenttext = String.Replace(currenttext, searchpatterns[j], replacements[j]);
		   }

				//Add it to the result
				result[i] = currenttext;
	}

	return result;
}
};
# ----------------------------------------
current = Autodesk.AutoCAD.DynamoNodes.Document.Current()
layers = Autodesk.AutoCAD.DynamoNodes.Document.Layers(document=current)
code_block_2 = CodeBlock()
# ---------- code_block_2.designscript (11 lines) ----------
[
"TABL",
"TITL",
"PATT",
"OFFS",
"ASSM",
"LABL",
"CORR",
"PROF",
"BNDY"
];
# ----------------------------------------
code_block_3 = CodeBlock()
# ---------- code_block_3.designscript (11 lines) ----------
[
"TABLE",
"TITLE",
"PATTERN",
"OFFSET",
"ASSEMBLY",
"LABEL",
"CORRIDOR",
"PROFILE",
"BNDY"
];
# ----------------------------------------
code_block_4 = CodeBlock(t=layers, s=code_block_2, r=code_block_3) { ReplaceMultiplePatterns(t,s,r); }
